# Grasshopper definition gh2ghx-converter.ghx (Grasshopper 1.0.7)

path = FilePath("C:\Users\David Rutten\Desktop\GH\")
path_2 = FilePath("C:\Users\David Rutten\Desktop\GHX\")
c_script = CSharpScript(Convert=Toggle(False), FolderIn=path, FolderOut=path_2)  # -> out, Files; inputs Convert: Boolean, FolderIn: String, FolderOut: String
# ---------- c_script: C# ----------
    if (!Convert) return;

    if (!System.IO.Directory.Exists(FolderIn)) return;
    if (!System.IO.Directory.Exists(FolderOut))
      System.IO.Directory.CreateDirectory(FolderOut);

    // Note: this could be made recursive, but additional code will be required.
    string[] files = System.IO.Directory.GetFiles(FolderIn, "*.gh", SearchOption.TopDirectoryOnly);

    // No gh files found in the source directory.
    if (files == null || files.Length == 0) return;

    List<string> convertedFiles = new List<string>();
    foreach (string file in files)
    {
      string filename = System.IO.Path.GetFileNameWithoutExtension(file) + ".ghx";
      string filepath = FolderOut + filename;

      // Do not override already converted files.
      if (System.IO.File.Exists(filepath))
        continue;

      GH_Archive archive = new GH_Archive();
      if (!archive.ReadFromFile(file))
        continue;

      if (archive.WriteToFile(filepath, false, false))
        convertedFiles.Add(filepath);
    }

    Files = convertedFiles;
# ---------- end c_script ----------
panel = Panel(c_script.Files)
